# Grasshopper definition remake_surface.gh (Grasshopper 0.9.76)
# plug-ins: Python Interpreter

v = Slider(11, range=1..20)
u = Slider(15, range=1..20)
surface = Surface(<surface referenced from the Rhino model>)

# ---- group: curve=ghc.BrepEdges(srf)[0]
brep_edges = BrepEdges(Brep=surface)  # -> Naked, Interior, NonManifold
list_item = ListItem(List=brep_edges.Naked, Index="4", Wrap=True)
list_item_2 = ListItem(List=brep_edges.Naked, Index="1", Wrap=True)
list_item_3 = ListItem(List=brep_edges.Naked, Index="2", Wrap=True)
list_item_4 = ListItem(List=brep_edges.Naked, Index="3", Wrap=True)

# ----
python_script = PythonScript(srf=surface, u=u, v=v)  # -> new_srf; inputs srf: Brep
# ---------- python_script: Python ----------
import ghpythonlib.components as ghc
curve=ghc.BrepEdges(srf)[0]
curve1=[]
for i in range(0,4):
  if i%2==0:
    curve1.append(ghc.Interpolate(ghc.DivideCurve(curve[i],u,False)[0],3,False,0)[0])
  else:
    curve1.append(ghc.Interpolate(ghc.DivideCurve(curve[i],v,False)[0],3,False,0)[0])    
new_srf=ghc.EdgeSurface(curve1[0],curve1[1],curve1[2],curve1[3])
# ---------- end python_script ----------
surface_2 = Surface(python_script)

# ---- group: ghc.DivideCurve(curve[i],u,False)[0]
u_2 = Slider(15, range=1..20)
v_2 = Slider(11, range=1..20)
divide_curve = DivideCurve(Curve=[list_item_4, list_item_2], Count=u_2, Kinks=False)  # -> Points, Tangents, Parameters
divide_curve_2 = DivideCurve(Curve=[list_item_3, list_item], Count=v_2, Kinks=False)  # -> Points, Tangents, Parameters

# ---- group: ghc.Interpolate(ghc.DivideCurve(curve[i],u,False)[0],3,False,0)[0]
interpolate = Interpolate(Vertices=divide_curve_2.Points, Degree=3, Periodic=False, KnotStyle=0)  # -> flatten(Curve), Length, Domain
interpolate_2 = Interpolate(Vertices=divide_curve.Points, Degree=3, Periodic=False, KnotStyle=0)  # -> flatten(Curve), Length, Domain

# ---- group: ghc.EdgeSurface(curve1[0],curve1[1],curve1[2],curve1[3]
list_item_5 = ListItem(List=simplify(interpolate_2.Curve), Index="1", Wrap=True)
list_item_6 = ListItem(List=interpolate_2.Curve, Index="2", Wrap=True)
list_item_7 = ListItem(List=interpolate.Curve, Index="2", Wrap=True)
list_item_8 = ListItem(List=interpolate.Curve, Index="1", Wrap=True)
edge_surface = EdgeSurface(CurveA=list_item_5, CurveB=list_item_6, CurveC=list_item_8, CurveD=list_item_7)
