# Grasshopper definition tutorial.gh (Grasshopper 0.9.76)
# plug-ins: Python Interpreter

edges = BrepEdges(Brep=<geometry referenced from the Rhino model>)  # -> Naked, Interior, NonManifold
panel = Panel(edges.Naked)
item = ListItem(List=edges.Naked, Index=Slider(0, range=0..100), Wrap=True)
item_2 = ListItem(List=edges.Naked, Index=Slider(3, range=0..100), Wrap=True)
item_3 = ListItem(List=edges.Naked, Index=Slider(2, range=0..100), Wrap=True)
item_4 = ListItem(List=edges.Naked, Index=Slider(1, range=0..100), Wrap=True)

number_slider = Slider(100, range=0..100)
crv = Curve(item_2)
divide = DivideCurve(Curve=crv, Count=number_slider, Kinks=False)  # -> Points, Tangents, Parameters
intcrv = Interpolate(Vertices=divide.Points, Degree=Slider(3, range=0..10), Periodic=Toggle(False), KnotStyle=Slider(0, range=0..100))  # -> Curve, Length, Domain

number_slider_2 = Slider(50, range=0..50)
crv_2 = Curve(item_3)
divide_2 = DivideCurve(Curve=crv_2, Count=number_slider_2, Kinks=False)  # -> Points, Tangents, Parameters
intcrv_2 = Interpolate(Vertices=divide_2.Points, Degree=Slider(3, range=0..10), Periodic=Toggle(False), KnotStyle=Slider(0, range=0..100))  # -> Curve, Length, Domain

crv_3 = Curve(item_4)
divide_3 = DivideCurve(Curve=crv_3, Count=number_slider, Kinks=False)  # -> Points, Tangents, Parameters
intcrv_3 = Interpolate(Vertices=divide_3.Points, Degree=Slider(3, range=0..10), Periodic=Toggle(False), KnotStyle=Slider(0, range=0..100))  # -> Curve, Length, Domain

crv_4 = Curve(item)
divide_4 = DivideCurve(Curve=crv_4, Count=number_slider_2, Kinks=False)  # -> Points, Tangents, Parameters
intcrv_4 = Interpolate(Vertices=divide_4.Points, Degree=Slider(3, range=0..10), Periodic=Toggle(False), KnotStyle=Slider(0, range=0..100))  # -> Curve, Length, Domain

gen_surface = PythonScript(u1=crv, u2=crv_3, v1=crv_2, v2=crv_4, nnu=number_slider, nnv=number_slider_2)  # -> out, surface; inputs u1: Curve, u2: Curve, v1: Curve, v2: Curve, nnu: Int32, nnv: Int32
# ---------- gen_surface: Python ----------
import ghpythonlib.components
def ip_curve(curve,dnum,degree,ks):
    dcurve = ghpythonlib.components.DivideCurve(curve,dnum)[0]
    icurve = ghpythonlib.components.Interpolate(dcurve,degree,False,ks)[0]
    return icurve
ks = 0
degree = 3
curve1 = ip_curve(u1,nnu,degree,ks)
curve2 = ip_curve(u2,nnu,degree,ks)
curve3 = ip_curve(v1,nnu,degree,ks)
curve4 = ip_curve(v2,nnu,degree,ks)
surface = ghpythonlib.components.EdgeSurface(curve1,curve2,curve3,curve4)
# ---------- end gen_surface ----------

edgesrf = EdgeSurface(CurveA=intcrv.Curve, CurveB=intcrv_3.Curve, CurveC=intcrv_2.Curve, CurveD=intcrv_4.Curve)
